# Grasshopper definition Example 9 - ReadResults.gh (Grasshopper 1.0.7)
# plug-ins: FEM-Design

info = Info(versionWhenCreated="23.2.0")

# ----
# Get model file path
python = GhPythonScript()  # -> out, folder
# ---------- python: Python ----------
__author__ = "MarcoPellegrinoKonsu"
__version__ = "2022.06.30"

import rhinoscriptsyntax as rs

folder = rs.DocumentPath()
# ---------- end python ----------
str_file = Panel("myModel.str")
concat = Concatenate(FragmentA=python.folder, FragmentB=str_file)
path = FilePath(concat)

# ----
# Open and read model
fem_design_connection = FEMDesignConnection(Verbosity="ScriptLogLinesOnly", DeleteOutputFolder=False)
fem_design_openmodel = FEMDesignOpenModel(Connection=fem_design_connection, Model=path, RunNode=True)  # -> Connection, Model, Success

# ----
# Use 'ResultsType' value list component
# to select the result to be returned.
# NOTE
# The results can be extracted if the model has been analysed.
# FEM-design will generate an ".strFEM" file from which we will read the results.
# Selecting more than one ResultType will generate a
# DataTree structure in the 'Results' output.
# You can use 'BANG' or 'Branch' to select the desire result.
resultstype = ResultsType({"NodalDisplacement", "PointSupportReaction", "PointSupportReactionMinMax", "PointConnectionForce", "BarDisplacement", "BarInternalForce", "BarStress", "LineSupportReaction", "LineConnectionResultant", "LineConnectionForce", "SurfaceSupportReaction", "ShellDisplacement", "ShellInternalForce", "ShellStress", "CLTShellUtilization", "CLTFireUtilization", "LabelledSectionInternalForce", "LabelledSectionResultant", "NodalVibrationShape", "EigenFrequencies", "CriticalParameter", "ImperfectionFactor", "QuantityEstimationConcrete", "QuantityEstimationSteel", "QuantityEstimationTimber", "QuantityEstimationTimberPanel", "QuantityEstimationGeneral", "QuantityEstimationReinforcement", "FiniteElement"}, selected="NodalDisplacement")
fem_design_getcasecombresults = FEMDesignGetCaseCombResults(Connection=fem_design_openmodel.Connection, ResultType=resultstype, RunNode=True)  # -> Connection, Results, Success
fem_design_getfemodel = FEMDesignGetFeModel(Connection=fem_design_openmodel.Connection, RunNode=True)  # -> Connection, FiniteElement, Success
nodaldisplacement = NodalDisplacement(Result=fem_design_getcasecombresults.Results, CaseCombinationName="Self weight")  # -> CaseIdentifier, ElementId, NodeId, Translation, Rotation

resultstype_2 = ResultsType({"NodalDisplacement", "PointSupportReaction", "PointSupportReactionMinMax", "PointConnectionForce", "BarDisplacement", "BarInternalForce", "BarStress", "LineSupportReaction", "LineConnectionResultant", "LineConnectionForce", "SurfaceSupportReaction", "ShellDisplacement", "ShellInternalForce", "ShellStress", "CLTShellUtilization", "CLTFireUtilization", "LabelledSectionInternalForce", "LabelledSectionResultant", "NodalVibrationShape", "EigenFrequencies", "CriticalParameter", "ImperfectionFactor", "QuantityEstimationConcrete", "QuantityEstimationSteel", "QuantityEstimationTimber", "QuantityEstimationTimberPanel", "QuantityEstimationGeneral", "QuantityEstimationReinforcement", "FiniteElement"}, selected=["NodalDisplacement", "PointSupportReaction"])
fem_design_getcasecombresults_2 = FEMDesignGetCaseCombResults(Connection=fem_design_openmodel.Connection, ResultType=resultstype_2, RunNode=True)  # -> Connection, Results, Success
bang = ExplodeTree(Data=fem_design_getcasecombresults_2.Results)  # -> Branch0, Branch1
panel = Panel(bang.Branch1)
branch = TreeBranch(Tree=fem_design_getcasecombresults_2.Results, Path="1", MaintainPaths=True)
nodaldisplacement_2 = NodalDisplacement(Result=[fem_design_getcasecombresults.Results, bang.Branch0], CaseCombinationName="Self weight")  # -> CaseIdentifier, ElementId, NodeId, Translation, Rotation
pointsupportreaction = PointSupportReaction(Result=branch, CaseCombinationName="self weight")  # -> CaseIdentifier, Identifier, NodeId, SupportPosition, ReactionForce, ReactionMoment, ForceResultant, MomentResultant

# ---- group: Finite Element from FEMDesign
data = Data(fem_design_getfemodel.FiniteElement)
femshell = FiniteElementFemShell(FiniteElement=data)  # -> Identifier, ElementId, FaceIndex, MeshGeometry
fembar = FiniteElementFemBar(FiniteElement=data)  # -> Identifier, ElementId, NodeI, NodeJ, LineGeometry
femnode = FiniteElementFemNode(FiniteElement=data)  # -> NodeId, Point

# ----
pointsupportreaction_2 = PointSupportReaction(Result=bang.Branch1, CaseCombinationName="self weight")  # -> CaseIdentifier, Identifier, NodeId, SupportPosition, ReactionForce, ReactionMoment, ForceResultant, MomentResultant

geo = Geometry(fembar.LineGeometry)
geo_2 = Geometry(femshell.MeshGeometry)
int = Integer(femnode.NodeId)
geo_3 = Geometry(femnode.Point)

int_2 = Integer(nodaldisplacement.NodeId)
multiplication = Multiplication(A=nodaldisplacement.Translation, B=Slider(100, range=0..100))
keysearch = KeyValueSearch(Keys=int, Values=geo_3, Search=int_2)
move = Move(Geometry=keysearch, Motion=multiplication)  # -> Geometry, Transform
