# Grasshopper definition intSurface_OnBars.gh (Grasshopper 1.0.7)
# plug-ins: FEM-Design

file_struxml = FilePath("C:\GitHub\femdesign-api\FemDesign.Examples\Grasshopper\Interaction_Surface\OnBar\ConcreteBars.struxml")
model_readfromfile = ModelReadFromFile(FilePath=file_struxml)
model_deconstruct = ModelDeconstruct(Model=model_readfromfile)  # -> CountryCode, Foundations, Bars, FictitiousBars, Shells, FictitiousShells, Diaphragms, LabelledSection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
interactionsurface_onbar = InteractionSurfaceOnBar(Bar=model_deconstruct.Bars, FUlt=True, Offset=0)  # -> InteractionSurface, N, My, Mz
panel = Panel(interactionsurface_onbar.My)
panel_2 = Panel(interactionsurface_onbar.N)
panel_3 = Panel(interactionsurface_onbar.Mz)
mesh = Mesh(interactionsurface_onbar.InteractionSurface)
