# Grasshopper definition Practical example - Voronoi Structure.gh (Grasshopper 1.0.7)
# plug-ins: FEM-Design

default = MaterialDatabaseDefault(CountryCode="S")  # -> SteelMaterial, ConcreteMaterial, TimberMaterial, ReinforcementMaterial, StratumMaterial, CustomMaterial
default_2 = MaterialDatabaseDefault(CountryCode="S")  # -> SteelMaterial, ConcreteMaterial, TimberMaterial, ReinforcementMaterial, StratumMaterial, CustomMaterial
default_3 = SectionDatabaseDefault()  # -> SteelSection, ConcreteSection, TimberSection, HollowCoreSection, CustomSection
list = ValueList({"ordinary", "dead_load", "soil_dead_load", "shrinkage", "prestressing", "fire", "seis_sxp", "seis_sxm", "seis_syp", "seis_sym"}, selected="ordinary")
list_2 = ValueList({"permanent", "long-term", "medium-term", "short-term", "instantaneous"}, selected="permanent")
list_3 = ValueList({"ordinary", "dead_load", "soil_dead_load", "shrinkage", "prestressing", "fire", "seis_sxp", "seis_sxm", "seis_syp", "seis_sym"}, selected="ordinary")
list_4 = ValueList({"permanent", "long-term", "medium-term", "short-term", "instantaneous"}, selected="permanent")
item = ListItem(List=default.SteelMaterial, Index=0, Wrap=True)
item_2 = ListItem(List=default_3.SteelSection, Index=0, Wrap=True)
item_3 = ListItem(List=default_2.ConcreteMaterial, Index=0, Wrap=True)
construct = LoadCaseConstruct(Name="LiveLoad", Type=list, DurationClass=list_2)
construct_2 = LoadCaseConstruct(Name="DeadLoad", Type=list_3, DurationClass=list_4)
pt = Point([Point(4.654447505, 0, 0), Point(5.382943045, 0, 0), Point(20, 7.759798047, 0), Point(20, 9.693800464, 0), Point(4.424989963, 10, 0), Point(2.545068843, 10, 0)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])
material = Data(item)
# Dummy Geometry
crv = Curve([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])
section = Data(item_2)
srf = Surface([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])
merge = Merge(Data1=construct_2, Data2=construct)
simple = PointSupportSimple(Position=pt, Tx=True, Ty=True, Tz=True, Rx=True, Ry=True, Rz=True, Identifier="S")
construct_3 = PlateConstruct(Surface=srf, Thickness="0.15", Material=item_3, Identifier="P")
beam = BarsBeam(Curve=crv, Material=material, Section=section, OrientLCS=True, Identifier="B")
list_5 = ValueList({"ultimate_ordinary", "ultimate_accidental", "ultimate_seismic", "serviceability_quasi_permanent", "serviceability_frequent", "serviceability_characteristic"}, selected="ultimate_ordinary")
panel = Panel("""1.35
1.5""")
data = Data(merge)
Z = UnitZ(Factor="-1.00")
Z_2 = UnitZ(Factor="-2.00")
construct_4 = LoadCombinationConstruct(Name="ULS", Type=list_5, LoadCase=data, Gamma=panel)
uniform = SurfaceLoadUniform(Surface=srf, Force=Z_2, LoadCase=construct)
force = LineLoadForce(Curve=crv, StartForce=Z, LoadCase=construct, ConstLoadDir=True, LoadProjection=False)
loadcombinations = Data(flatten(construct_4))
loadcases = Data(flatten(merge))
elements = Data(flatten([beam, simple, construct_3]))
loads = Data(flatten([force, uniform]))
construct_5 = ModelConstruct(CountryCode="S", StructureElements=elements, Loads=loads, LoadCases=loadcases, LoadCombinations=loadcombinations)
toggle = BooleanToggle(True)
define = AnalysisDefine(
    CalcCase=toggle,
    CalcCstage=False,
    CalcImpf=False,
    CalcComb=toggle,
    CalcGmax=False,
    CalcStab=False,
    CalcFreq=False,
    CalcSeis=False,
    CalcDesign=False,
    CalcFootfall=False,
    Elemfine=False,
    Diaphragm=False,
    PeakSmoothing=False)
runanalysis = ApplicationRunAnalysis(FdModel=construct_5, Analysis=define, EndSession=False, CloseOpenWindows=False, RunNode=Toggle(True))  # -> FdModel, FdFeaModel, Results, HasExited
